# Dynamo graph IMPORT PBR.dyn (Dynamo 2.16.2.5624)
# packages: bimorphNodes 4.2.4, WombatDynamo 2.3.4, Genius Loci 2023.2.21, Data-Shapes 2022.2.106, Clockwork for Dynamo 2.x 2.4.0

select_model_element = DSModelElementSelection()  # 1 picked in the model
code_block = CodeBlock { "_PO_znacky"; }
fromLayers = CADTextData.FromLayers(importInstance=select_model_element, layerNames=code_block)
textValue = CADTextData.TextValue(cADTextData=fromLayers.CADTextData)
code_block_2 = CodeBlock { ["5A","8A","13A","21A","27A","34A","21B","34B","55B","70B","89B","113B","144B","183B"]; }
eq = textValue@L1 == code_block_2  # lacing=CrossProduct
anyTrue = List.AnyTrue(list=eq@L2)
filterByBoolMask = List.FilterByBoolMask(list=fromLayers.CADTextData@L2, mask=anyTrue)
flatten = List.Flatten(list=filterByBoolMask.in)
textValue_2 = CADTextData.TextValue(cADTextData=flatten)
code_block_3 = CodeBlock { " volný"; }
add = textValue_2 + code_block_3
code_block_4 = CodeBlock { "#Hasící přístroj, ruční"; }
byName = Family.ByName(name=code_block_4)
types = Family.Types(family=byName)
firstItem = List.FirstItem(list=types)
uniqueItems = List.UniqueItems(list=add)
name = Family.Name(family=types)
eq_2 = uniqueItems == name  # lacing=CrossProduct
anyTrue_2 = List.AnyTrue(list=eq_2@L2)
filterByBoolMask_2 = List.FilterByBoolMask(list=uniqueItems, mask=anyTrue_2)
duplicate = ElementType.Duplicate(elementType=firstItem, name=filterByBoolMask_2.out)
passthrough = Custom[Passthrough](passThrough=add, waitFor=duplicate)  # package Clockwork for Dynamo 2.x; Forces a sequential order of execution. The node wired into the output of the Passthrough node will be executed *after* the node wired into the waitFor input (e.g. important for some Revit operations). The value of the passThrough input will be passed on to the node wired into the output port of the Passthrough node.
byName_2 = FamilyType.ByName(name=passthrough)
originPoint = CADTextData.OriginPoint(cADTextData=flatten)
XAxis = Vector.XAxis()
reverse = Vector.Reverse(vector=XAxis)
ZAxis = Vector.ZAxis()
rotation = CADTextData.Rotation(cADTextData=flatten)
rotate = Vector.Rotate(vector=reverse, axis=ZAxis, degrees=rotation)
code_block_5 = CodeBlock { 350; }
translate = Geometry.Translate(geometry=originPoint, direction=rotate, distance=code_block_5)
YAxis = Vector.YAxis()
reverse_2 = Vector.Reverse(vector=YAxis)
ZAxis_2 = Vector.ZAxis()
rotate_2 = Vector.Rotate(vector=reverse_2, axis=ZAxis_2, degrees=rotation)
translate_2 = Geometry.Translate(geometry=translate, direction=rotate_2, distance=code_block_5)
code_block_6 = CodeBlock { "1NP"; }
byName_3 = WombatDynamo.Level.ByName(name=code_block_6)
byPointAndLevel = FamilyInstance.ByPointAndLevel(familyType=byName_2, point=translate_2, level=byName_3)
element_setrotation = Custom[Element SetRotation](element=byPointAndLevel, degree=rotation)  # package Genius Loci; Set the angle of the element around its local Z-axis. (Same as the Rotate command in Revit)
multipleinputform = Custom[MultipleInputForm ++]()  # package Data-Shapes; Create a form with multiple inputs. see www.data-shapes.net for tutorials and infos!; unwired: Inputs
code_block_7 = CodeBlock { "Nástěnný"; false; }
setParameterByName = Element.SetParameterByName(parameterName=code_block_7.out0, value=code_block_7.out1)  # unwired: element
