# Dynamo graph MOVE IFC TO SURVEY POINT.dyn (Dynamo 2.16.2.5624)
# packages: Genius Loci 2023.2.21

string = StringInput("33563")
element_by_id = ElementById(Id=string)
surveyPoint = Coordinates.SurveyPoint()
element_setlocation = Custom[Element SetLocation](element=element_by_id, location=surveyPoint)  # package Genius Loci; Modify the location of the given element. (Same as the Move command in Revit.) Works for point/ line/ sketch based elements, view-specific elements, groups and link instances.
