# Dynamo graph ROOMS TO CEILINGS.dyn (Dynamo 3.2.1.5366)
# packages: Rhythm 2023.5.5

místnosti = DSModelElementsByCategorySelection("OST_Rooms")  # 1 picked in the model; graph input
finishBoundary = Room.FinishBoundary(room=místnosti)
typ_podhledu = CeilingTypes("Pororoštový podhled, chodby + šatny")  # graph input
ʳʰʸᵗʰᵐ_rooms_level = Rhythm.Revit.Elements.Rooms.Level(room=místnosti)
byOutlineTypeAndLevel = Ceiling.ByOutlineTypeAndLevel(outlineCurves=finishBoundary, ceilingType=typ_podhledu, level=ʳʰʸᵗʰᵐ_rooms_level)
code_block = CodeBlock { "Výškové odsazení od podlaží"; }
odsazení_od_podlaží = DoubleInput(3000)  # graph input
setParameterByName = Element.SetParameterByName(element=byOutlineTypeAndLevel, parameterName=code_block, value=odsazení_od_podlaží)
