# Dynamo graph ROOMS TO FLOORS.dyn (Dynamo 3.2.1.5366)
# packages: Rhythm 2023.5.5, Crumple 2024.4.3, archi-lab.net 2025.300.1225, Clockwork for Dynamo 2.x 2.6.0

# group: Pick doors
code_block = CodeBlock { "Dveře"; }
byName = Category.ByName(name=code_block)
all_elements_of_category = ElementsOfCategory(Category=byName)
elementType = Element.ElementType(element=all_elements_of_category)
code_block_2 = CodeBlock { "Štítek"; }
getParameterValueByName = Element.GetParameterValueByName(element=elementType, parameterName=code_block_2)
code_block_3 = CodeBlock { "#Dveře"; }
eq = getParameterValueByName == code_block_3
filterByBoolMask = List.FilterByBoolMask(list=all_elements_of_category, mask=eq)
flatten = List.Flatten(list=filterByBoolMask.in)

# group: Room geometry
select_model_element_by_category = DSModelElementByCategorySelection("OST_Rooms")  # 1 picked in the model; graph input
ʳʰʸᵗʰᵐ_rooms_level = Rhythm.Revit.Elements.Rooms.Level(room=select_model_element_by_category)
plane = Custom[Level.Plane](level=ʳʰʸᵗʰᵐ_rooms_level)  # package Clockwork for Dynamo 2.x; Retrieves the plane of a given level
geometry = Element.Geometry(element=select_model_element_by_category)
intersect = Geometry.Intersect(geometry=plane, other=geometry)
flatten_2 = List.Flatten(list=intersect)
typ_podlahy = FloorTypes("F/01 - Sportovní podlaha - parkety")  # graph input

count = List.Count(list=select_model_element_by_category)
ofRepeatedItem = List.OfRepeatedItem(item=flatten, amount=count)

# group: Filter doors by rooms
doors_tofrom = Custom[© Doors.ToFrom](doors=flatten)  # package Crumple; Given a door, attempts to return its to and from room properties as well as how many rooms it relates to.
number = Room.Number(room=doors_tofrom.fromRoom)
number_2 = Room.Number(room=select_model_element_by_category)

ofRepeatedItem_2 = List.OfRepeatedItem(item=number, amount=count)

# group (continued): Filter doors by rooms
eq_2 = ofRepeatedItem_2 == number_2
filterByBoolMask_2 = List.FilterByBoolMask(list=ofRepeatedItem, mask=eq_2)

flatten_3 = List.Flatten(list=filterByBoolMask_2.in)

# group: Idk what i am doing here
location = archilab.Revit.Elements.Elements.Location(element=flatten_3)
closestPointTo = Geometry.ClosestPointTo(geometry=flatten_2, other=location.Point, lacing=Longest)
byTwoPoints = Vector.ByTwoPoints(start=closestPointTo, end=location.Point)
distanceTo = Geometry.DistanceTo(geometry=location.Point, other=closestPointTo)
translate = Geometry.Translate(geometry=location.Point, direction=byTwoPoints, distance=distanceTo)
ZAxis = Vector.ZAxis()
code_block_4 = CodeBlock { 90; }
rotate = Vector.Rotate(vector=byTwoPoints, axis=ZAxis, degrees=code_block_4)
code_block_5 = CodeBlock { "Hrubá šířka"; }
getParameterValueByName_2 = Element.GetParameterValueByName(element=flatten_3, parameterName=code_block_5)
round = Math.Round(number=getParameterValueByName_2)
code_block_6 = CodeBlock(x=round) { x/2; }
translate_2 = Geometry.Translate(geometry=translate, direction=rotate, distance=code_block_6)
byTwoPoints_2 = Vector.ByTwoPoints(start=translate_2, end=translate)
translate_3 = Geometry.Translate(geometry=translate_2, direction=byTwoPoints_2, distance=round)
closestPointTo_2 = Geometry.ClosestPointTo(geometry=flatten_2, other=translate_3, lacing=Longest)
closestPointTo_3 = Geometry.ClosestPointTo(geometry=flatten_2, other=translate_2, lacing=Longest)
list_create = List.Create(item0=translate_2, item1=translate_3, item2=closestPointTo_2, item3=closestPointTo_3)
code_block_7 = CodeBlock { 1; }
shiftIndices = List.ShiftIndices(list=list_create, amount=code_block_7)
byStartPointEndPoint = Line.ByStartPointEndPoint(startPoint=list_create, endPoint=shiftIndices)

# group: Finish here
transpose = List.Transpose(lists=byStartPointEndPoint)
byJoinedCurves = PolyCurve.ByJoinedCurves(curves=transpose)
byPatch = Surface.ByPatch(closedCurve=byJoinedCurves)
list_create_2 = List.Create(item0=byPatch, item1=flatten_2)
flatten_4 = List.Flatten(list=list_create_2)
clean = archilab.Lists.Lists.Clean(list=flatten_4)
byUnion = Surface.ByUnion(surfaces=clean@L2)
perimeterCurves = Surface.PerimeterCurves(surface=byUnion)
byGroupedCurves = PolyCurve.ByGroupedCurves(curves=perimeterCurves)
curves = PolyCurve.Curves(polyCurve=byGroupedCurves@L1)

byPatch_2 = Surface.ByPatch(closedCurve=byGroupedCurves)
area = Surface.Area(surface=byPatch_2)
flatten_5 = List.Flatten(list=area)
sort = List.Sort(list=area)
reverse = List.Reverse(list=sort@L2)
flatten_6 = List.Flatten(list=reverse)
code_block_8 = CodeBlock { 0; }
getItemAtIndex = List.GetItemAtIndex(list=flatten_6, index=code_block_8)
indexOf = List.IndexOf(list=flatten_5, element=getItemAtIndex)
getItemAtIndex_2 = List.GetItemAtIndex(list=curves, index=indexOf)
byOutlineTypeAndLevel = Floor.ByOutlineTypeAndLevel(outlineCurves=getItemAtIndex_2, floorType=typ_podlahy, level=ʳʰʸᵗʰᵐ_rooms_level)  # graph output; frozen
