# Dynamo graph ROOMS TO MASS BETTER.dyn (Dynamo 2.16.2.5624)
# packages: archi-lab.net 2023.213.1722

select_model_element = DSModelElementSelection()  # 1 picked in the model
select_model_element_2 = DSModelElementSelection()  # 1 picked in the model
list_create = List.Create(item0=select_model_element, item1=select_model_element_2)
flatten = List.Flatten(list=list_create)
faces = archilab.Revit.Elements.Room.Faces(room=flatten)
list_create_2 = List.Create(item0=faces.Boundary)
flatten_2 = List.Flatten(list=list_create_2)
normalAtParameter = Surface.NormalAtParameter(surface=list_create_2)
Z = Vector.Z(vector=normalAtParameter)
ZAxis = Vector.ZAxis()
reverse = Vector.Reverse(vector=ZAxis)
Z_2 = Vector.Z(vector=reverse)
eq = Z == Z_2
flatten_3 = List.Flatten(list=eq)
filterByBoolMask = List.FilterByBoolMask(list=flatten_2, mask=flatten_3)
code_block = CodeBlock { "Neohraničená výška"; }
getParameterValueByName = Element.GetParameterValueByName(element=flatten, parameterName=code_block)
thicken = Surface.Thicken(surface=filterByBoolMask.in, thickness=getParameterValueByName)
byUnion = Solid.ByUnion(solids=thicken)
categories = Categories("OST_Mass")
byGeometry = DirectShape.ByGeometry(geometry=byUnion, category=categories)
