# Dynamo graph ROOMBOOK.dyn (Dynamo 2.16.2.5624)

# group: Filter rooms
categories = Categories("OST_Rooms")
all_elements_of_category = ElementsOfCategory(Category=categories)
code_block = CodeBlock { "Oddělení"; }
getParameterValueByName = Element.GetParameterValueByName(element=all_elements_of_category, parameterName=code_block)
code_block_2 = CodeBlock { "Blok A"; }
eq = getParameterValueByName == code_block_2
filterByBoolMask = List.FilterByBoolMask(list=all_elements_of_category, mask=eq)
code_block_3 = CodeBlock { "Plocha"; }
getParameterValueByName_2 = Element.GetParameterValueByName(element=filterByBoolMask.in, parameterName=code_block_3)
code_block_4 = CodeBlock { 0; }
gt = getParameterValueByName_2 > code_block_4
isNull = Object.IsNull(object=gt)
filterByBoolMask_2 = List.FilterByBoolMask(list=filterByBoolMask.in, mask=isNull)

# group: Get parameter values
code_block_5 = CodeBlock { "Číslo"; "Název"; "Plocha"; }
getParameterValueByName_3 = Element.GetParameterValueByName(element=filterByBoolMask_2.out, parameterName=code_block_5.out0)
getParameterValueByName_4 = Element.GetParameterValueByName(element=filterByBoolMask_2.out, parameterName=code_block_5.out1)
getParameterValueByName_5 = Element.GetParameterValueByName(element=filterByBoolMask_2.out, parameterName=code_block_5.out2)

# group: Edit room area string
code_block_6 = CodeBlock { 1; }
round = Math.Round(number=getParameterValueByName_5, digits=code_block_6)
string_from_object = FromObject(object=round)
code_block_7 = CodeBlock { "."; ","; }
replace = String.Replace(string=string_from_object, searchFor=code_block_7.out0, replaceWith=code_block_7.out1)
code_block_8 = CodeBlock { -1; -5; }
remove = String.Remove(string=replace, startIndex=code_block_8.out0, count=code_block_8.out1)

# group: Export to excel
file_path = Filename("C:\OneDrive\OneDrive - PFM-Group a.s\Testing\Nový List Microsoft Excelu.xlsx")  # graph input; frozen
code_block_9 = CodeBlock { 3; 3; }
exportToExcel = Data.ExportToExcel(filePath=file_path, sheetName=getParameterValueByName_3@L1, startRow=code_block_9.out0, startColumn=code_block_9.out1, data=getParameterValueByName_4@L1, lacing=Longest)
code_block_10 = CodeBlock { 5; 5; }
exportToExcel_2 = Data.ExportToExcel(filePath=file_path, sheetName=getParameterValueByName_3@L1, startRow=code_block_10.out0, startColumn=code_block_10.out1, data=remove@L1, lacing=Longest)
