# Dynamo graph PBR FROM CAD.dyn (Dynamo 2.16.2.5624)
# packages: bimorphNodes 4.2.4, DynamoMEP 1.0.3, Crumple 2022.5.27, Genius Loci 2023.2.21, WombatDynamo 2.3.4, spring nodes 210.1.1

# group: Inputs
select_model_element = DSModelElementSelection()  # 1 picked in the model
code_block = CodeBlock { "_PO_hranice-PU"; }
code_block_2 = CodeBlock { "1NP"; }
code_block_3 = CodeBlock { "_PO_popis"; }

# group: Area view
level_byname = Custom[Level ByName](name=code_block_2)  # package Genius Loci; Collects Levels by name in the active or given document.
byLevel = WombatDynamo.AreaPlanView.ByLevel(level=level_byname)
id = Element.Id(element=byLevel)
element_by_id = ElementById(Id=id)
list_create = List.Create(item0=byLevel)

# group: Boundaries
curvesFromCADLayers = CAD.CurvesFromCADLayers(importInstance=select_model_element, layerNames=code_block)
byCurveAndView = DynamoMEP.AreaBoundary.ByCurveAndView(curve=curvesFromCADLayers.Curve, view=element_by_id)

# group: CAD text
fromLayers = CADTextData.FromLayers(importInstance=select_model_element, layerNames=code_block_3)
height = CADTextData.Height(cADTextData=fromLayers.CADTextData)
code_block_4 = CodeBlock { 400; }
gt = height > code_block_4
filterByBoolMask = List.FilterByBoolMask(list=fromLayers.CADTextData, mask=gt)
textValue = CADTextData.TextValue(cADTextData=filterByBoolMask.in)
flatten = List.Flatten(list=textValue)
code_block_5 = CodeBlock { "/"; "-"; }
replace = String.Replace(string=flatten, searchFor=code_block_5.out0, replaceWith=code_block_5.out1)
originPoint = CADTextData.OriginPoint(cADTextData=filterByBoolMask.in)

# group: Create mass family
file_path = Filename("..\..\..\ProgramData\Autodesk\RVT 2023\Family Templates\Czech\Koncepční objemy\Objem.rft")
categories = Categories("OST_Mass")
ꟿ_familyinstance_bygeometry = Custom[ꟿ FamilyInstance.ByGeometry](familyTemplatePath=file_path, familyName=replace, category=categories)  # package spring nodes; You must provide a valid family template path that will be used for all input geometry objects. The project units(and not the templates) will be used to determine the size of the output geometry. The provided category will be used only if the family template supports it. If not, the default template category will be used instead. Likewise, the family material(provided as a string) will be set only if a material with that name exists in the template. If not, the default material will be used instead ("By Category"). For void cuts, the material settings will be ignored. The Subcategory name is an optional input. If you'd like to skip assigning a Subcategory to any new instance, simply use null. The node expects a unique family name for each geometry object. The rest of the input lists will be processed as if the node lacing is set to longest.; unwired: geometry

areas_create = Custom[© Areas.Create](view=list_create, points=originPoint)  # package Crumple; Given a view and a list of points, will create new areas at them. Note that you will need to provide a single view and list of points, or apply @levels to your inputs to have them work.
boundaries = Area.Boundaries(area=areas_create)
byJoinedCurves = PolyCurve.ByJoinedCurves(curves=boundaries)
byPatch = Surface.ByPatch(closedCurve=byJoinedCurves)
code_block_6 = CodeBlock { 2500; }
thicken = Surface.Thicken(surface=byPatch, thickness=code_block_6)
