# Dynamo graph TREES FROM CAD.dyn (Dynamo 2.16.2.5624)
# packages: bimorphNodes 4.2.4

select_model_element = DSModelElementSelection()  # 1 picked in the model
curvesFromCADLayers = CAD.CurvesFromCADLayers(importInstance=select_model_element)
flatten = List.Flatten(list=curvesFromCADLayers.Curve)
centerPoint = Circle.CenterPoint(circle=flatten)
Z = Point.Z(point=centerPoint)
X = Point.X(point=centerPoint)
Y = Point.Y(point=centerPoint)
code_block = CodeBlock { 0; }

# group: Family types
family_types = FamilyTypes()  # nothing selected
byCoordinates = Point.ByCoordinates(x=X, y=Y, z=code_block)
levels = Levels("1NP")
byPointAndLevel = FamilyInstance.ByPointAndLevel(familyType=family_types, point=byCoordinates, level=levels)
