# Dynamo graph CHANGE WALL MATERIAL.dyn (Dynamo 2.6.2.15705)
# packages: Clockwork for Dynamo 2.x 2.4.0, spring nodes 210.1.1

categories = Categories("OST_Walls")
ꟿ_collect_alltypesof = Custom[ꟿ Collect.AllTypesOf](CategoryOrElemType=categories)  # package spring nodes; Works with either categories, element types or revit classes and uses multi-filters to get multiple groups with a single query. Can be applied as a function. No ties to the Document.Changed event.
name = Family.Name(family=ꟿ_collect_alltypesof)
code_block = CodeBlock { "Obecn"; }
contains = String.Contains(str=name, searchFor=code_block)
filterByBoolMask = List.FilterByBoolMask(list=ꟿ_collect_alltypesof, mask=contains)
code_block_2 = CodeBlock { 0; }
code_block_3 = CodeBlock { "Hliník"; }
byName = Material.ByName(name=code_block_3)
setCompoundLayerMaterial = Custom[FamilyType.SetCompoundLayerMaterial](familyType=filterByBoolMask.in, layerIndex=code_block_2, material=byName)  # package Clockwork for Dynamo 2.x; Sets the material of a specified compound layer of a given family type (only applies to family types that have a compound structure, e.g. walls, floors etc.).
